# Grasshopper definition geometry_generation.ghx (Grasshopper 1.0.7)

# Additive
number_slider = Slider(0, range=0..10)
# 00
mesh = Mesh([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])
deconstruct_mesh = DeconstructMesh(Mesh=mesh)  # -> Vertices, Faces, Colours, flatten(Normals)
list_item = ListItem(List=deconstruct_mesh.Normals, Index=0, Wrap=True)
populate_geometry = PopulateGeometry(Geometry=mesh, Count=100, Seed=1)  # -> flatten(Population)
list_length = ListLength(List=populate_geometry)
repeat_data = RepeatData(Data=ColourSwatch(SwatchColor=RGB(171, 72, 72)), Length=list_length)
repeat_data_2 = RepeatData(Data=list_item, Length=list_length)

# ---- group: export mesh to .ply
ghpython_script = GhPythonScript(meshes=mesh, idx=number_slider, folder_name="00_Additive", export=Toggle(True))  # -> out, a; inputs meshes: list of Mesh, export: Boolean
# ---------- ghpython_script: Python ----------
__author__ = "eleni"
__version__ = "2024.03.20"

import Rhino
import System
import scriptcontext
import sys
import os


HERE = ghenv.LocalScope.ghdoc.Path
FOLDER = os.path.abspath(os.path.join(HERE, '..', '..', folder_name + "/0" + idx))
filename = "0" + idx + '_mesh.ply'
filepath = os.path.join(FOLDER, filename)


#bake meshes to Rhino
new_attributes = Rhino.DocObjects.ObjectAttributes()

for mesh in meshes:  
    Rhino.RhinoDoc.ActiveDoc.Objects.AddMesh(mesh, new_attributes)

#export to .ply
    
write_options = Rhino.FileIO.FileWriteOptions()
write_options.WriteSelectedObjectsOnly = False

ply_options = Rhino.FileIO.FilePlyWriteOptions(write_options)
ply_options.UseSimpleDialog = True

if export:
    rc = Rhino.FileIO.FilePly.Write(filepath, Rhino.RhinoDoc.ActiveDoc, ply_options)
    if rc == Rhino.PlugIns.WriteFileResult.Success:
        print "Success, file saved:", filepath
    else:
        print "Error saving file:", filepath
    
    
#delete meshes from Rhino
objects = Rhino.RhinoDoc.ActiveDoc.Objects.FindByLayer("Default")
for obj in objects:
    Rhino.RhinoDoc.ActiveDoc.Objects.Remove(obj)
# ---------- end ghpython_script ----------

# ---- group: export PCD to .ply
ghpython_script_2 = GhPythonScript(
    points=populate_geometry,
    colors=repeat_data,
    normals=repeat_data_2,
    idx=number_slider,
    folder_name="00_Additive",
    export=Toggle(True))  # -> out; inputs points: list of Point3d, colors: list, normals: list, export: Boolean
# ---------- ghpython_script_2: Python ----------
__author__ = "eleni"
__version__ = "2024.03.20"

import Rhino.Geometry as rg
import Rhino
import System
import scriptcontext
import sys
import os


HERE = ghenv.LocalScope.ghdoc.Path
FOLDER = os.path.abspath(os.path.join(HERE, '..', '..', folder_name + "/0" + idx))
filename = "0" + idx + '_pt.ply'
filepath = os.path.join(FOLDER, filename)


#bake meshes to Rhino
new_attributes = Rhino.DocObjects.ObjectAttributes()
pcd = rg.PointCloud()

for p,n,c in zip(points,normals,colors):
    pcd.Add(p,n,c)

Rhino.RhinoDoc.ActiveDoc.Objects.AddPointCloud(pcd, new_attributes)

#export to .ply
    
write_options = Rhino.FileIO.FileWriteOptions()
write_options.WriteSelectedObjectsOnly = False

ply_options = Rhino.FileIO.FilePlyWriteOptions(write_options)
ply_options.UseSimpleDialog = True

if export:
    rc = Rhino.FileIO.FilePly.Write(filepath, Rhino.RhinoDoc.ActiveDoc, ply_options)
    if rc == Rhino.PlugIns.WriteFileResult.Success:
        print "Success, file saved:", filepath
    else:
        print "Error saving file:", filepath
    
    
#delete meshes from Rhino
objects = Rhino.RhinoDoc.ActiveDoc.Objects.FindByLayer("Default")
for obj in objects:
    Rhino.RhinoDoc.ActiveDoc.Objects.Remove(obj)
# ---------- end ghpython_script_2 ----------

# ----
panel = Panel(ghpython_script_2)
panel_2 = Panel(ghpython_script.out)
mesh_2 = Mesh(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)
# Subtractive
# 00
number_slider_2 = Slider(0, range=0..10)
deconstruct_mesh_2 = DeconstructMesh(Mesh=mesh_2)  # -> Vertices, Faces, Colours, Normals
panel_3 = Panel("""13
14
15""")
list_item_2 = ListItem(List=deconstruct_mesh_2.Normals, Index=0, Wrap=True)
populate_geometry_2 = PopulateGeometry(Geometry=mesh_2, Count=Slider(1000, range=0..1000), Seed=1)  # -> flatten(Population)
list_length_2 = ListLength(List=populate_geometry_2)
repeat_data_3 = RepeatData(Data=ColourSwatch(SwatchColor=RGB(171, 72, 72)), Length=list_length_2)
repeat_data_4 = RepeatData(Data=list_item_2, Length=list_length_2)

# ---- group: export mesh to .ply and joint indexes to .txt
ghpython_script_3 = GhPythonScript(meshes=mesh_2, idx=number_slider_2, folder_name="01_Subtractive", joint_faces_idx=panel_3, export=Toggle(True))  # -> out, a; inputs meshes: list of Mesh, joint_faces_idx: list, export: Boolean
# ---------- ghpython_script_3: Python ----------
__author__ = "eleni"
__version__ = "2024.03.20"

import Rhino
import System
import scriptcontext
import sys
import os


HERE = ghenv.LocalScope.ghdoc.Path
FOLDER = os.path.abspath(os.path.join(HERE, '..', '..', folder_name + "/0" + idx))
filename1 = "0" + idx + '_mesh.ply'
filepath = os.path.join(FOLDER, filename1)


#bake meshes to Rhino
new_attributes = Rhino.DocObjects.ObjectAttributes()

for mesh in meshes:  
    Rhino.RhinoDoc.ActiveDoc.Objects.AddMesh(mesh, new_attributes)

#export to .ply
    
write_options = Rhino.FileIO.FileWriteOptions()
write_options.WriteSelectedObjectsOnly = False

ply_options = Rhino.FileIO.FilePlyWriteOptions(write_options)
ply_options.UseSimpleDialog = True

if export:
    rc = Rhino.FileIO.FilePly.Write(filepath, Rhino.RhinoDoc.ActiveDoc, ply_options)
    if rc == Rhino.PlugIns.WriteFileResult.Success:
        print "Success, file saved:", filepath
    else:
        print "Error saving file:", filepath
    
    
#delete meshes from Rhino
objects = Rhino.RhinoDoc.ActiveDoc.Objects.FindByLayer("Default")
for obj in objects:
    Rhino.RhinoDoc.ActiveDoc.Objects.Remove(obj)
    
    
#export face indexes to .txt
filename2 = "0" + idx + '_joint_face_indexes.txt'
filepath = os.path.join(FOLDER, filename2)

with open(filepath, "w+") as f:
    for face in joint_faces_idx:
        data = str(face)
        f.write(data + "\n")
# ---------- end ghpython_script_3 ----------

# ---- group: export PCD to .ply
ghpython_script_4 = GhPythonScript(
    points=populate_geometry_2,
    colors=repeat_data_3,
    normals=repeat_data_4,
    idx=number_slider_2,
    folder_name="01_Subtractive",
    export=Toggle(True))  # -> out; inputs points: list of Point3d, colors: list, normals: list, export: Boolean; same code as ghpython_script_2

# ----
panel_4 = Panel(ghpython_script_4)
panel_5 = Panel(ghpython_script_3.out)
