# Grasshopper definition assembly_beam_system.ghx (Grasshopper 1.0.8)
# plug-ins: RhinoCodePluginGH

brep = Brep([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])

# ---- group: build assembly
dfbuildassembly = DFBuildAssembly(i_assembly_name="test_name", i_breps=brep)  # -> o_assembly; inputs i_assembly_name: String, i_breps: list of Brep
#   port i_assembly_name: The name of the assembly to export.
#   port i_breps: The breps of the structure.
#   port o_assembly: The create DFAssembly object representing the timber elements.
# ---------- dfbuildassembly: Python ----------
#! python3

import System
import typing

import Rhino
import Rhino.Geometry as rg
import scriptcontext as sc

from ghpythonlib.componentbase import executingcomponent as component

import diffCheck
from diffCheck.df_geometries import DFBeam, DFAssembly


class DFBuildAssembly(component):
    def RunScript(self,
            i_assembly_name: str,
            i_breps: System.Collections.Generic.List[Rhino.Geometry.Brep]):
        """
            This component parse a series of breps representing a timber structure or a 
            timber elements into a DFAssembly object.
            
            :param i_assembly_name: the name of the assembly
            :param i_breps: list of breps

            :return o_assembly: the DFAssembly object
        """
        beams: typing.List[DFBeam] = []
        for brep in i_breps:
            beam = DFBeam.from_brep_face(brep)
            beams.append(beam)

        o_assembly = DFAssembly(beams, i_assembly_name)

        return o_assembly


# if __name__ == "__main__":
#     comp = DFBuildAssembly()
#     o_assembly = comp.RunScript(
#         i_assembly_name,
#         i_breps
#     )
# ---------- end dfbuildassembly ----------

# ---- group: deconstruct assembly
dfdeconstructassembly = DFDeconstructAssembly(i_assembly=dfbuildassembly)  # -> o_beams
#   port i_assembly: The DFAssembly object to deconstruct.
#   port o_beams: The set of beams contained by this DFAssembly object.
# ---------- dfdeconstructassembly: Python ----------
#! python3

import System
import typing

import Rhino
import Rhino.Geometry as rg
import scriptcontext as sc

from ghpythonlib.componentbase import executingcomponent as component

import diffCheck
from diffCheck.df_geometries import DFBeam, DFAssembly


class DFDeconstructAssembly(component):
    def RunScript(self, i_assembly):
        """
            Deconstruct the DFAssembly into a set of df_beams objects.
            
            :param i_assembly: the DFAssembly object

            :return o_beams
        """
        o_beams = i_assembly.beams

        return o_beams


# if __name__ == "__main__":
#     comp = DFDeconstructAssembly()
#     o_beams = comp.RunScript(
#         i_assembly
#     )
# ---------- end dfdeconstructassembly ----------

# ---- group: deconstruct beam
dfdeconstructbeam = DFDeconstructBeam(i_beams=graft(dfdeconstructassembly))  # -> o_side_faces, o_joint_faces, o_joint_ids; inputs i_beams: list
#   port i_beams: The DFBeam objects to deconstruct.
#   port o_side_faces: The side faces of as Breps of the beam.
#   port o_joint_faces: The faces as Breps belonging to joints of the beam.
#   port o_joint_ids: An integer indicating to which joint the joint faces are belonging to.
# ---------- dfdeconstructbeam: Python ----------
#! python3

import System
import typing

import Rhino
import Rhino.Geometry as rg
import scriptcontext as sc

from ghpythonlib.componentbase import executingcomponent as component

import diffCheck
from diffCheck.df_geometries import DFBeam, DFAssembly


class DFDeconstructBeam(component):
    def RunScript(self, i_beams: System.Collections.Generic.List[object]):
        """
            Deconstruct the DFBeam object into Rhino objects.
            
            :param i_beams: the DFBeam objects

            :return o_side_faces: the side joints of the beam
            :return o_joint_faces: the face joints of the beam
            :return o_joint_ids: the ids for each face joint
        """
        o_side_faces, o_joint_faces, o_joint_ids, o_breps = [], [], [], []

        for i_b in i_beams:
            o_side_faces = [f.to_brep_face() for f in i_b.side_faces]
            o_joint_faces = [f.to_brep_face() for f in i_b.joint_faces]
            o_joint_ids = [f.joint_id for f in i_b.joint_faces]

        return o_side_faces, o_joint_faces, o_joint_ids

# if __name__ == "__main__":
#     comp = DFDeconstructBeam()
#     o_side_faces, o_joint_faces, o_joint_ids = comp.RunScript(
#         i_beams
#     )
# ---------- end dfdeconstructbeam ----------

# ----
custom_preview = CustomPreview(Geometry=dfdeconstructbeam.o_joint_faces, Material=ColourSwatch(SwatchColor=RGB(64, 255, 105)))
custom_preview_2 = CustomPreview(Geometry=dfdeconstructbeam.o_side_faces, Material=ColourSwatch(SwatchColor=RGB(121, 64, 255)))
panel = Panel(dfdeconstructbeam.o_joint_ids)
