# Grasshopper definition error_viz_tester_components.ghx (Grasshopper 1.0.8)
# plug-ins: RhinoCodePluginGH, MeshEdit Components, Bifocals

panel = Panel("""0
1""")

construct_point = ConstructPoint(XCoordinate=Slider(1, range=0..1), YCoordinate=Slider(0, range=0..1), ZCoordinate=Slider(0, range=0..1))
mesh = Mesh(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)
move = Move(Geometry=mesh, Motion=construct_point)  # -> Geometry, Transform
volume = Volume(Geometry=move.Geometry)  # -> Volume, Centroid
scale = Scale(Geometry=move.Geometry, Center=volume.Centroid, Factor=Slider(1.1, range=0..10))  # -> Geometry, Transform
number_slider = Slider(200, range=0..600)
mesh_explode = MeshExplode(Mesh=mesh, Interpolate=False)
mesh_explode_2 = MeshExplode(Mesh=scale.Geometry, Interpolate=False)
populate_geometry = PopulateGeometry(Geometry=mesh_explode_2, Count=number_slider, Seed=Slider(2, range=0..10))  # -> simplify(Population)
populate_geometry_2 = PopulateGeometry(Geometry=mesh_explode, Count=number_slider, Seed=1)
flatten_tree = FlattenTree(Tree=populate_geometry_2, Path="{0}")
flatten_tree_2 = FlattenTree(Tree=populate_geometry, Path="{0}")
point_cloud_attributes = PointCloudAttributes(Locations=flatten_tree)  # -> Cloud, Locations, Normals, Colours, Extra, Hidden
point_cloud_attributes_2 = PointCloudAttributes(Locations=flatten_tree_2)  # -> Cloud, Locations, Normals, Colours, Extra, Hidden
move_2 = Move(Geometry=point_cloud_attributes.Cloud, Motion=Vector(0, 0, 10))  # -> Geometry, Transform

number_slider_2 = Slider(1, range=0..1)
pcd_faces = PointCloud(flatten(Tree({0}: [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], {1}: [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])))
panel_2 = Panel(pcd_faces)
unit_z = UnitZ(Factor=Slider(0.1, range=0..0.1))
panel_3 = Panel("diffCheck")
df_histogram_scale_factor = Slider(0.13, range=0..1)
df_value_t = ValueList({"Dist", "RMSE", "MAX", "MIN", "STD"}, selected="Dist")
df_palette = ValueList({"Jet", "Rainbow", "RdPu", "Viridis"}, selected="Jet")
point_cloud = PointCloud([point_cloud_attributes.Cloud, move_2.Geometry])
point_cloud_2 = PointCloud([point_cloud_attributes_2.Cloud, move_2.Geometry])
df_legend_height = Slider(10, range=0..20)
df_legend_width = Slider(0.5, range=0..2)
invalid_point_cloud = PointCloud(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)
dfcloudclouddistance = DFCloudCloudDistance(i_cloud_source=point_cloud, i_cloud_target=point_cloud_2, i_swap=Toggle(False))  # -> o_distances, o_rmse, o_max_deviation, o_min_deviation, o_std_deviation, o_result; inputs i_cloud_source: list of PointCloud, i_cloud_target: list of PointCloud, i_swap: Boolean
#   port i_cloud_source: The source point cloud.
#   port i_cloud_target: The target cloud.
#   port i_swap: whether to swap source and target
#   port o_result: The result of the distance calculation.
# ---------- dfcloudclouddistance: Python ----------
#! python3

import System
import typing

import Rhino
import Rhino.Geometry as rg
from ghpythonlib.componentbase import executingcomponent as component

import Grasshopper as gh
from Grasshopper.Kernel import GH_RuntimeMessageLevel as RML

import diffCheck
from diffCheck import df_cvt_bindings
from diffCheck import df_error_estimation

import diffCheck.df_util


class CloudCloudDistance(component):
    def RunScript(self,
            i_cloud_source: System.Collections.Generic.List[Rhino.Geometry.PointCloud],
            i_cloud_target: System.Collections.Generic.List[Rhino.Geometry.PointCloud],
            i_swap: bool):
        """
            The cloud-to-cloud component computes the distance between each point in the source point cloud and its nearest neighbour in thr target point cloud.

            :param i_cloud_source: a list of source point cloud
            :param i_cloud_target: a list of target point cloud to calculate distances to

            :return o_distances : list of calculated distances for each point
            :return o_rmse: the root mean squared error between corresponding points of source and target
            :return o_max_deviation: the max deviation between source and target
            :return o_min_deviation: the min deviation between source and target
            :return o_std_deviation: the standard deviation between source and target
            :returns o_resluts: the results of the comparison all in one object
        """

        if i_cloud_source is None or i_cloud_target is None:
            ghenv.Component.AddRuntimeMessage(RML.Warning, "Please provide both objects of type point clouds to compare")
            return None

        # swap
        if i_swap is True:
            temp = i_cloud_source
            i_cloud_source = i_cloud_target
            i_cloud_target = temp

        # conversion
        df_cloud_source_list = [df_cvt_bindings.cvt_rhcloud_2_dfcloud(i_cl_s) for i_cl_s in i_cloud_source]
        df_cloud_target_list = [df_cvt_bindings.cvt_rhcloud_2_dfcloud(i_cl_t) for i_cl_t in i_cloud_target]

        # calculate distances
        o_results = df_error_estimation.df_cloud_2_df_cloud_comparison(df_cloud_source_list, df_cloud_target_list)

        return o_results.distances, o_results.distances_rmse, o_results.distances_max_deviation, o_results.distances_min_deviation, o_results.distances_sd_deviation, o_results


# if __name__ == "__main__":
#     com = CloudCloudDistance()
#     o_distances, o_rmse, o_max_deviation, o_min_deviation, o_std_deviation, o_results = com.RunScript(
#         i_cloud_source,
#         i_cloud_target,
#         i_swap
#         )
# ---------- end dfcloudclouddistance ----------
file_path = FilePath("C:\Users\eleni\Desktop\DC\temp")
df_legend_plane = Plane()
button = Button()
dfvisualizationsettings = DFVisualizationSettings(
    i_value_type=df_value_t,
    i_palette=df_palette,
    i_legend_height=df_legend_height,
    i_legend_width=df_legend_width,
    i_legend_plane=df_legend_plane,
    i_histogram_scale_factor=df_histogram_scale_factor)  # -> o_viz_settings; inputs i_value_type: String, i_palette: String, i_upper_threshold: Double, i_lower_threshold: Double, i_legend_height: Double, i_legend_width: Double, i_legend_plane: Plane, i_histogram_scale_factor: Double, i_one_histogram_per_item: Double
#   port i_legend_height: Set the total height of the legend
#   port i_legend_width: Set the total width of the legend
#   port i_legend_plane: A construction plane for the legend
#   port i_one_histogram_per_item: make one curve per item
#   port o_viz_settings: Settings to be passed to the Visualization component
# ---------- dfvisualizationsettings: Python ----------
#! python3

import System
import typing
import Rhino
from ghpythonlib.componentbase import executingcomponent as component
import Grasshopper as gh
from Grasshopper import Instances
from Grasshopper.Kernel import GH_RuntimeMessageLevel as RML

from diffCheck import df_visualization


def add_str_valuelist(self,
    values_list: typing.List[str],
    nickname: str,
    indx: int,
    X_param_coord: float,
    Y_param_coord: float,
    X_offset: int=87
    ) -> None:
    """
        Adds a value list of string values to the component input

        :param values_list: a list of string values to add to the value list
        :param nickname: the nickname of the value list
        :param indx: the index of the input parameter
        :param X_param_coord: the x coordinate of the input parameter
        :param Y_param_coord: the y coordinate of the input parameter
        :param X_offset: the offset of the value list from the input parameter
    """
    param = ghenv.Component.Params.Input[indx]  # noqa: F821
    if param.SourceCount == 0:
        valuelist = gh.Kernel.Special.GH_ValueList()
        valuelist.NickName = nickname
        valuelist.Description = "Select the value to use with DFVizSettings"
        selected = valuelist.FirstSelectedItem
        valuelist.ListItems.Clear()
        for v in values_list:
            vli = gh.Kernel.Special.GH_ValueListItem(str(v),str('"' + v + '"'))
            valuelist.ListItems.Add(vli)
        if selected in values_list:
            valuelist.SelectItem(values_list.index(selected))
        valuelist.CreateAttributes()
        valuelist.Attributes.Pivot = System.Drawing.PointF(
            X_param_coord - (valuelist.Attributes.Bounds.Width) - X_offset,
            Y_param_coord - (valuelist.Attributes.Bounds.Height / 2 + 0.1)
            )
        valuelist.Attributes.ExpireLayout()
        gh.Instances.ActiveCanvas.Document.AddObject(valuelist, False)
        ghenv.Component.Params.Input[indx].AddSource(valuelist)  # noqa: F821

def add_slider(self,
    nickname: str,
    indx: int,
    lower_bound: float,
    upper_bound: float,
    default_value: float,
    X_param_coord: float,
    Y_param_coord: float,
    X_offset: int=100
    ) -> None:
    """
        Adds a slider to the component input

        :param nickname: the nickname of the slider
        :param indx: the index of the input parameter
        :param X_param_coord: the x coordinate of the input parameter
        :param Y_param_coord: the y coordinate of the input parameter
        :param X_offset: the offset of the slider from the input parameter
    """
    param = ghenv.Component.Params.Input[indx]  # noqa: F821
    if param.SourceCount == 0:
        slider = gh.Kernel.Special.GH_NumberSlider()
        slider.NickName = nickname
        slider.Description = "Set the value for the threshold"
        slider.Slider.Minimum = System.Decimal(lower_bound)
        slider.Slider.Maximum = System.Decimal(upper_bound)
        slider.Slider.DecimalPlaces = 3
        slider.Slider.SmallChange = System.Decimal(0.001)
        slider.Slider.LargeChange = System.Decimal(0.01)
        slider.Slider.Value = System.Decimal(default_value)
        slider.CreateAttributes()
        slider.Attributes.Pivot = System.Drawing.PointF(
            X_param_coord - (slider.Attributes.Bounds.Width) - X_offset,
            Y_param_coord - (slider.Attributes.Bounds.Height / 2 - 0.1)
            )
        slider.Attributes.ExpireLayout()
        gh.Instances.ActiveCanvas.Document.AddObject(slider, False)
        ghenv.Component.Params.Input[indx].AddSource(slider)  # noqa: F821

def add_plane_object(self,
    nickname: str,
    indx: int,
    X_param_coord: float,
    Y_param_coord: float,
    X_offset: int=75
    ) -> None:
    """
        Adds a plane object to the component input

        :param nickname: the nickname of the plane object
        :param indx: the index of the input parameter
        :param X_param_coord: the x coordinate of the input parameter
        :param Y_param_coord: the y coordinate of the input parameter
        :param X_offset: the offset of the plane object from the input parameter
    """
    param = ghenv.Component.Params.Input[indx]  # noqa: F821
    if param.SourceCount == 0:
        doc = Instances.ActiveCanvas.Document
        if doc:
            plane = gh.Kernel.Parameters.Param_Plane()
            plane.NickName = nickname
            plane.CreateAttributes()
            plane.Attributes.Pivot = System.Drawing.PointF(
                X_param_coord - (plane.Attributes.Bounds.Width) - X_offset,
                Y_param_coord
                )
            plane.Attributes.ExpireLayout()
            doc.AddObject(plane, False)
            ghenv.Component.Params.Input[indx].AddSource(plane)  # noqa: F821


class DFVisualizationSettings(component):
    def __init__(self):
        self.poss_value_types = ["Dist", "RMSE", "MAX", "MIN", "STD"]
        self.poss_palettes = ["Jet", "Rainbow", "RdPu", "Viridis"]

        ghenv.Component.ExpireSolution(True)  # noqa: F821
        ghenv.Component.Attributes.PerformLayout()  # noqa: F821
        params = getattr(ghenv.Component.Params, "Input")  # noqa: F821
        for j in range(len(params)):
            Y_cord = params[j].Attributes.InputGrip.Y
            X_cord = params[j].Attributes.Pivot.X
            input_indx = j
            if "i_value_type" == params[j].NickName:
                add_str_valuelist(
                    ghenv.Component,  # noqa: F821
                    self.poss_value_types,
                    "DF_value_t",
                    input_indx, X_cord, Y_cord)
            if "i_palette" == params[j].NickName:
                add_str_valuelist(
                    ghenv.Component,  # noqa: F821
                    self.poss_palettes,
                    "DF_palette",
                    input_indx, X_cord, Y_cord)
            if "i_legend_height" == params[j].NickName:
                add_slider(
                    ghenv.Component,  # noqa: F821
                    "DF_legend_height",
                    input_indx,
                    0.000, 20.000, 10.000,
                    X_cord, Y_cord)
            if "i_legend_width" == params[j].NickName:
                add_slider(
                    ghenv.Component,  # noqa: F821
                    "DF_legend_width",
                    input_indx,
                    0.000, 2.000, 0.500,
                    X_cord, Y_cord)
            if "i_legend_plane" == params[j].NickName:
                add_plane_object(
                    ghenv.Component,  # noqa: F821
                    "DF_legend_plane",
                    input_indx, X_cord, Y_cord)
            if "i_histogram_scale_factor" == params[j].NickName:
                add_slider(
                    ghenv.Component,  # noqa: F821
                    "DF_histogram_scale_factor",
                    input_indx,
                    0.000, 1.000, 0.01,
                    X_cord, Y_cord)

    def RunScript(self,
            i_value_type: str,
            i_palette: str,
            i_upper_threshold: float,
            i_lower_threshold: float,
            i_legend_height: float,
            i_legend_width: float,
            i_legend_plane: Rhino.Geometry.Plane,
            i_histogram_scale_factor: float,
            i_one_histogram_per_item: float):

        """
        Compiles all the visualization settings to feed to the visualization component

        :param i_value_type: selected type indicates Which values to display. Possible values: "dist", "RMSE", "MAX", "MIN", "STD"
        :param i_palette: Select a color palette to map the values to. Possible values: "Jet", "Rainbow", "RdPu", "Viridis"
        :param i_upper_threshold: Thresholds the values with a maximum value
        :param i_lower_threshold: Thresholds the values with a minimum value
        :param i_legend_height: the total height of the legend
        :param i_legend_width: the total width of the legend
        :param i_legend_plane: the construction plane of the legend
        :param i_histogram_scale_factor: Scales the height of the histogram with a factor

        :returns o_viz_settings: the results of the comparison all in one object
        """
        # set default values
        if i_value_type is not None:
            if i_value_type not in self.poss_value_types:
                ghenv.Component.AddRuntimeMessage(RML.Warning, "Possible values for i_value_type are: dist, RMSE, MAX, MIN, STD")  # noqa: F821
                return None
        else:
            i_value_type = "Dist"
        if i_palette is not None:
            if i_palette not in self.poss_palettes:
                ghenv.Component.AddRuntimeMessage(RML.Warning, "Possible values for i_palette are: Jet, Rainbow, RdPu, Viridis")  # noqa: F821
                return None
        else:
            i_palette = "Jet"
        if i_legend_height is None:
            i_legend_height = 10
        if i_legend_width is None:
            i_legend_width = 0.5
        if i_legend_plane is None:
            i_legend_plane = Rhino.Geometry.Plane.WorldXY
        if i_histogram_scale_factor is None:
            i_histogram_scale_factor = 0.01
        if i_one_histogram_per_item is None:
            i_one_histogram_per_item = False

        # pack settings
        o_viz_settings = df_visualization.DFVizSettings(i_value_type,
                                                        i_palette,
                                                        i_upper_threshold,
                                                        i_lower_threshold,
                                                        i_legend_height,
                                                        i_legend_width,
                                                        i_legend_plane,
                                                        i_histogram_scale_factor,
                                                        i_one_histogram_per_item)

        return o_viz_settings

# if __name__ == "__main__":
#     com = DFVisualizationSettings()
#     o_viz_settings = com.RunScript(
#         i_value_type,
#         i_palette,
#         i_upper_threshold,
#         i_lower_threshold,
#         i_legend_height,
#         i_legend_width,
#         i_legend_plane,
#         i_histogram_scale_factor,
#         i_one_histogram_per_item
#         )
# ---------- end dfvisualizationsettings ----------
dfvisualization = DFVisualization(i_result=dfcloudclouddistance.o_result)  # -> o_colored_geo, o_legend, o_histogram
#   port i_result: The result of the distance calculation
#   port i_viz_settings: The settings of the visualization
#   port o_colored_geo: The geometry colored according to the distance results.
#   port o_legend: The legend of the visualization
#   port o_histogram: Histogram that shows the frequency of the values
# ---------- dfvisualization: Python ----------
#! python3

import System
import typing

import Rhino
import Rhino.Geometry as rg
from ghpythonlib.componentbase import executingcomponent as component

import Grasshopper as gh
from Grasshopper.Kernel import GH_RuntimeMessageLevel as RML

from diffCheck import df_cvt_bindings
from diffCheck import df_visualization
from diffCheck.df_visualization import DFVizSettings
from diffCheck.df_error_estimation import DFVizResults
from diffCheck import diffcheck_bindings

class Visualization(component):
    def RunScript(self, i_result, i_viz_settings):

        """
            Adds color to the mesh or point cloud
            and generates a corresponding legend and histogram

            :param i_result: a list of point clouds
            :param i_viz_settings: a list of DF beams

            :return o_colored_geo: the colored mesh or point cloud
            :return o_legend : the correesponding legend of the coloring
            :return o_histogram : a histogram that represents the frequency of the values
        """

        values, min_value, max_value = i_result.filter_values_based_on_valuetype(i_viz_settings)

        # check if i_result.source is a list of pointclouds or a mesh
        if type(i_result.source[0]) is diffcheck_bindings.dfb_geometry.DFPointCloud:

            # convert to Rhino PCD
            o_source = [df_cvt_bindings.cvt_dfcloud_2_rhcloud(src) for src in i_result.source]

            # color geometry
            o_colored_geo = [df_visualization.color_rh_pcd(src, dist, min_value, max_value, i_viz_settings.palette) for src, dist in zip(o_source, values)]

        elif type(i_result.source[0]) is rg.Mesh:
            # convert to Rhino Mesh
            o_source = i_result.source

            # color geometry
            o_colored_geo = [df_visualization.color_rh_mesh(src, dist, min_value, max_value, i_viz_settings.palette) for src, dist in zip(o_source, values)]

        o_legend = df_visualization.create_legend(min_value,
                                                  max_value,
                                                  i_viz_settings.palette,
                                                  steps=10,
                                                  plane=i_viz_settings.legend_plane,
                                                  width=i_viz_settings.legend_width,
                                                  total_height=i_viz_settings.legend_height)

        o_histogram = df_visualization.create_histogram(values,
                                                        min_value,
                                                        max_value,
                                                        steps=100,
                                                        plane=i_viz_settings.legend_plane,
                                                        total_height=i_viz_settings.legend_height,
                                                        scaling_factor=i_viz_settings.histogram_scale_factor)

        return o_colored_geo, o_legend, o_histogram


# if __name__ == "__main__":
#     com = Visualization()
#     o_colored_geo, o_legend, o_histogram  = com.RunScript(
#         i_result,
#         i_viz_settings
#         )
# ---------- end dfvisualization ----------

reciprocal = Brep([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])
unit_z_2 = UnitZ(Factor=Slider(0.1, range=0..18))

list_item = ListItem(List=reciprocal, Index=panel, Wrap=True)
dfbuildassembly = DFBuildAssembly(i_assembly_name="test", i_breps=list_item)  # -> o_assembly; inputs i_assembly_name: String, i_breps: list of Brep
#   port i_assembly_name: The name of the assembly to export.
#   port i_breps: The breps of the structure.
#   port o_assembly: The create DFAssembly object representing the timber elements.
# ---------- dfbuildassembly: Python ----------
#! python3

import System
import typing

import Rhino
import Rhino.Geometry as rg
import scriptcontext as sc

from ghpythonlib.componentbase import executingcomponent as component

import diffCheck
from diffCheck.df_geometries import DFBeam, DFAssembly


class DFBuildAssembly(component):
    def RunScript(self,
            i_assembly_name: str,
            i_breps: System.Collections.Generic.List[Rhino.Geometry.Brep]):
        """
            This component parse a series of breps representing a timber structure or a 
            timber elements into a DFAssembly object.
            
            :param i_assembly_name: the name of the assembly
            :param i_breps: list of breps

            :return o_assembly: the DFAssembly object
        """
        beams: typing.List[DFBeam] = []
        for brep in i_breps:
            beam = DFBeam.from_brep_face(brep)
            beams.append(beam)

        o_assembly = DFAssembly(beams, i_assembly_name)

        return o_assembly


# if __name__ == "__main__":
#     comp = DFBuildAssembly()
#     o_assembly = comp.RunScript(
#         i_assembly_name,
#         i_breps
#     )
# ---------- end dfbuildassembly ----------
dfdeconstructassembly = DFDeconstructAssembly(i_assembly=dfbuildassembly)  # -> o_beams
#   port i_assembly: The DFAssembly object to deconstruct.
#   port o_beams: The set of beams contained by this DFAssembly object.
# ---------- dfdeconstructassembly: Python ----------
"""Deconstruct the DFAssembly into a set of df_beams objects."""
#! python3



from ghpythonlib.componentbase import executingcomponent as component



class DFDeconstructAssembly(component):
    def RunScript(self, i_assembly):
        o_beams = i_assembly.beams
        return o_beams
# ---------- end dfdeconstructassembly ----------
panel_4 = Panel(dfdeconstructassembly)
dfdeconstructbeam = DFDeconstructBeam(i_beams=graft(dfdeconstructassembly))  # -> o_side_faces, o_joint_faces, o_joint_ids; inputs i_beams: list
#   port i_beams: The DFBeam objects to deconstruct.
#   port o_side_faces: The side faces of as Breps of the beam.
#   port o_joint_faces: The faces as Breps belonging to joints of the beam.
#   port o_joint_ids: An integer indicating to which joint the joint faces are belonging to.
# ---------- dfdeconstructbeam: Python ----------
"""Deconstruct the DFBeam objects into semantic Rhino objects."""
#! python3

import System

from ghpythonlib.componentbase import executingcomponent as component


class DFDeconstructBeam(component):
    def RunScript(self, i_beams: System.Collections.Generic.List[object]):
        o_side_faces, o_joint_faces, o_joint_ids = [], [], []

        for i_b in i_beams:
            o_side_faces = [f.to_brep_face() for f in i_b.side_faces]
            o_joint_faces = [f.to_brep_face() for f in i_b.joint_faces]
            o_joint_ids = [f.joint_id for f in i_b.joint_faces]

        return o_side_faces, o_joint_faces, o_joint_ids
# ---------- end dfdeconstructbeam ----------

dfdeconstructassembly_2 = DFDeconstructAssembly(i_assembly=dfbuildassembly)  # -> o_beams
#   port i_assembly: The DFAssembly object to deconstruct.
#   port o_beams: The set of beams contained by this DFAssembly object.
# ---------- dfdeconstructassembly_2: Python ----------
#! python3

import System
import typing

import Rhino
import Rhino.Geometry as rg
import scriptcontext as sc

from ghpythonlib.componentbase import executingcomponent as component

import diffCheck
from diffCheck.df_geometries import DFBeam, DFAssembly


class DFDeconstructAssembly(component):
    def RunScript(self, i_assembly):
        """
            Deconstruct the DFAssembly into a set of df_beams objects.
            
            :param i_assembly: the DFAssembly object

            :return o_beams
        """
        o_beams = i_assembly.beams

        return o_beams


# if __name__ == "__main__":
#     comp = DFDeconstructAssembly()
#     o_beams = comp.RunScript(
#         i_assembly
#     )
# ---------- end dfdeconstructassembly_2 ----------
dfdeconstructbeam_2 = DFDeconstructBeam(i_beams=graft(dfdeconstructassembly_2))  # -> simplify(o_side_faces), simplify(o_joint_faces), o_joint_ids; inputs i_beams: list
#   port i_beams: The DFBeam objects to deconstruct.
#   port o_side_faces: The side faces of as Breps of the beam.
#   port o_joint_faces: The faces as Breps belonging to joints of the beam.
#   port o_joint_ids: An integer indicating to which joint the joint faces are belonging to.
# ---------- dfdeconstructbeam_2: Python ----------
#! python3

import System
import typing

import Rhino
import Rhino.Geometry as rg
import scriptcontext as sc

from ghpythonlib.componentbase import executingcomponent as component

import diffCheck
from diffCheck.df_geometries import DFBeam, DFAssembly


class DFDeconstructBeam(component):
    def RunScript(self, i_beams: System.Collections.Generic.List[object]):
        """
            Deconstruct the DFBeam object into Rhino objects.
            
            :param i_beams: the DFBeam objects

            :return o_side_faces: the side joints of the beam
            :return o_joint_faces: the face joints of the beam
            :return o_joint_ids: the ids for each face joint
        """
        o_side_faces, o_joint_faces, o_joint_ids, o_breps = [], [], [], []

        for i_b in i_beams:
            o_side_faces = [f.to_brep_face() for f in i_b.side_faces]
            o_joint_faces = [f.to_brep_face() for f in i_b.joint_faces]
            o_joint_ids = [f.joint_id for f in i_b.joint_faces]

        return o_side_faces, o_joint_faces, o_joint_ids

# if __name__ == "__main__":
#     comp = DFDeconstructBeam()
#     o_side_faces, o_joint_faces, o_joint_ids = comp.RunScript(
#         i_beams
#     )
# ---------- end dfdeconstructbeam_2 ----------

panel_5 = Panel(dfdeconstructbeam_2.o_joint_faces)
populate_geometry_3 = PopulateGeometry(Geometry=dfdeconstructbeam_2.o_joint_faces, Count=100, Seed=1)
panel_6 = Panel(populate_geometry_3)
point_cloud_attributes_3 = PointCloudAttributes(Locations=populate_geometry_3)  # -> Cloud, Locations, Normals, Colours, Extra, Hidden
trim_tree = TrimTree(Tree=point_cloud_attributes_3.Cloud, Depth=1)
merge = Merge(Data1=dfdeconstructbeam_2.o_side_faces, Data2=dfdeconstructbeam_2.o_joint_faces)
list_item_2 = ListItem(List=flatten(trim_tree), Index=Slider(2, range=0..10), Wrap=True)
panel_7 = Panel(list_item_2)

populate_geometry_4 = PopulateGeometry(Geometry=merge, Count=number_slider, Seed=1)

trim_tree_2 = TrimTree(Tree=populate_geometry_4, Depth=1)

point_cloud_attributes_4 = PointCloudAttributes(Locations=trim_tree_2)  # -> Cloud, Locations, Normals, Colours, Extra, Hidden
move_3 = Move(Geometry=flatten(point_cloud_attributes_4.Cloud), Motion=unit_z_2)  # -> Geometry, Transform

dfnormalsegmentator = DFNormalSegmentator(i_cloud=point_cloud_attributes_4.Cloud)  # -> o_clusters; inputs i_cloud: PointCloud, i_normal_threshold_degree: Double, i_min_cluster_size: Int32, i_use_knn_neighborhood: Boolean, i_knn_neighborhood_size: Int32, i_radius_neighborhood_size: Double
#   port i_cloud: The point cloud to reduce the size.
#   port i_normal_threshold_degree: The normal threshold in degrees (under that it consider to the same cluster).
#   port i_min_cluster_size: The smallest cluster allowed.
#   port i_use_knn_neighborhood: If true use knn, otherwise radius search.
#   port i_knn_neighborhood_size: The knn size.
#   port i_radius_neighborhood_size: The size of the radius.
#   port o_clusters: The segmented clouds.
# ---------- dfnormalsegmentator: Python ----------
#! python3

import System
import typing

import Rhino
import Rhino.Geometry as rg
from ghpythonlib.componentbase import executingcomponent as component

import Grasshopper as gh
from Grasshopper.Kernel import GH_RuntimeMessageLevel as RML

import diffCheck
import diffCheck.df_geometries
from diffCheck.diffcheck_bindings import dfb_segmentation

from diffCheck import df_cvt_bindings


class DFCloudNormalSegmentator(component):
    def RunScript(self,
            i_cloud: Rhino.Geometry.PointCloud,
            i_normal_threshold_degree: float,
            i_min_cluster_size: int,
            i_use_knn_neighborhood: bool,
            i_knn_neighborhood_size: int,
            i_radius_neighborhood_size: float) -> rg.PointCloud:
        """
            Segment a point cloud into clusters based on normals.

            :param i_cloud: Point cloud to segment.
            :param i_normal_threshold_degree: Threshold in degrees to consider a normal as a cluster.
            :param i_min_cluster_size: Minimum size of a cluster.
            :param i_use_knn_neighborhood: Use KNN neighborhood.
            :param i_knn_neighborhood_size: Size of the KNN neighborhood.
            :param i_radius_neighborhood_size: Size of the radius neighborhood.
        """
        o_clusters = []
        df_cloud = df_cvt_bindings.cvt_rhcloud_2_dfcloud(i_cloud)

        if i_normal_threshold_degree is None:
            i_normal_threshold_degree = 20
        if i_min_cluster_size is None:
            i_min_cluster_size = 10
        if i_use_knn_neighborhood is None:
            i_use_knn_neighborhood = True
        if i_knn_neighborhood_size is None:
            i_knn_neighborhood_size = 30
        if i_radius_neighborhood_size is None:
            i_radius_neighborhood_size = 0.1

        o_clusters = dfb_segmentation.DFSegmentation.segment_by_normal(
            point_cloud=df_cloud,

            normal_threshold_degree=i_normal_threshold_degree,
            min_cluster_size=i_min_cluster_size,
            use_knn_neighborhood=i_use_knn_neighborhood,
            knn_neighborhood_size=i_knn_neighborhood_size,
            radius_neighborhood_size=i_radius_neighborhood_size
        )

        return [df_cvt_bindings.cvt_dfcloud_2_rhcloud(cluster) for cluster in o_clusters]

# if __name__ == "__main__":
#     com = DFCloudNormalSegmentator()
#     o_clusters = com.RunScript(
#         i_cloud,
#         i_normal_threshold_degree,
#         i_min_cluster_size,
#         i_use_knn_neighborhood,
#         i_knn_neighborhood_size,
#         i_radius_neighborhood_size
#         )
# ---------- end dfnormalsegmentator ----------
dfjointsegmentator = DFJointSegmentator(i_clusters=dfnormalsegmentator, i_assembly=dfbuildassembly)  # -> o_joint_face_segments, o_joint_segments, o_reference_point_clouds; inputs i_clusters: list of PointCloud, i_angle_threshold: Double, i_distance_threshold: Double, i_correspondence_distance: Double
#   port i_clusters: The cluster point clouds from normal segmentation.
#   port i_assembly: The assembly to extract the joints from
#   port i_angle_threshold: From 0 to 1, it's the sin value. By default 0.1. The closer to 0 the less permissive and viceversa to 1.
#   port i_distance_threshold: From 0 to infinite. By default 0.1. The closer to 0 the less permissive your point.
#   port i_correspondence_distance: The maximum correspondence distance for the local ICP registration that re-aligns the joints for per-face analysis of each joint. The default value is 0.005
#   port o_joint_face_segments: The individual faces of the extracted joints.
#   port o_joint_segments: The extracted joints.
#   port o_reference_point_clouds: The reference point clouds of the joints. They are generated from the
# ---------- dfjointsegmentator: Python ----------
"""Extracts the joints from a point cloud."""
#! python3

import System

import Rhino
import ghpythonlib.treehelpers

from diffCheck import diffcheck_bindings
from diffCheck import df_cvt_bindings as df_cvt

from ghpythonlib.componentbase import executingcomponent as component


ABSTOL = Rhino.RhinoDoc.ActiveDoc.ModelAbsoluteTolerance

class DFJointSegmentator(component):
    def __init__(self):
        super(DFJointSegmentator, self).__init__()
    def RunScript(self,
            i_clusters: System.Collections.Generic.List[Rhino.Geometry.PointCloud],
            i_assembly,
            i_angle_threshold: float,
            i_distance_threshold: float,
            i_correspondence_distance: float):

        if i_clusters is None or i_assembly is None:
            return None
        if i_angle_threshold is None:
            i_angle_threshold = 0.1
        if i_distance_threshold is None:
            i_distance_threshold = 0.1
        if i_correspondence_distance is None:
            i_correspondence_distance = 0.005
        if len(i_clusters) == 0:
            raise ValueError("No clusters given.")
        if not isinstance(i_clusters[0], Rhino.Geometry.PointCloud):
            raise ValueError("The input clusters must be PointClouds.")

        # get number of joints
        n_joints = i_assembly.total_number_joints

        # prepping the reference meshes
        df_joints = [[] for _ in range(n_joints)]
        for joint in i_assembly.all_joints:
            for face in joint.faces:
                face = face.to_mesh()
                face.Subdivide()
                face.Faces.ConvertQuadsToTriangles()
                df_joints[joint.id].append(df_cvt.cvt_rhmesh_2_dfmesh(face))

        o_reference_point_clouds = []
        o_joint_faces_segments = []
        df_cloud_clusters = [df_cvt.cvt_rhcloud_2_dfcloud(cluster) for cluster in i_clusters]
        df_joint_clouds = []

        # for each joint, find the corresponding faces, store them as such but also merge them, generate a reference point cloud, and register the merged clusters to the reference point cloud
        for df_joint in df_joints:
            rh_joint_faces_segments = []

            # create the reference point cloud
            ref_df_joint_cloud = diffcheck_bindings.dfb_geometry.DFPointCloud()
            for face in df_joint:
                ref_face_cloud = face.sample_points_uniformly(1000)
                ref_df_joint_cloud.add_points(ref_face_cloud)
            o_reference_point_clouds.append(df_cvt.cvt_dfcloud_2_rhcloud(ref_df_joint_cloud))

            # find the corresponding clusters and merge them
            df_joint_cloud = diffcheck_bindings.dfb_geometry.DFPointCloud()
            df_joint_face_segments = diffcheck_bindings.dfb_segmentation.DFSegmentation.associate_clusters(i_assembly.contains_cylinders, df_joint, df_cloud_clusters, i_angle_threshold, i_distance_threshold)
            for df_joint_face_segment in df_joint_face_segments:
                        df_joint_cloud.add_points(df_joint_face_segment)

            # register the joint faces to the reference point cloud
            transform = diffcheck_bindings.dfb_registrations.DFRefinedRegistration.O3DICP(df_joint_cloud, ref_df_joint_cloud, max_correspondence_distance = i_correspondence_distance)
            for df_joint_face_segment in df_joint_face_segments:
                df_joint_face_segment.apply_transformation(transform)
                rh_joint_faces_segments.append(df_cvt.cvt_dfcloud_2_rhcloud(df_joint_face_segment))
            df_joint_clouds.append(df_joint_cloud)
            o_joint_faces_segments.append(rh_joint_faces_segments)

        o_joint_segments = [df_cvt.cvt_dfcloud_2_rhcloud(df_joint_cloud) for df_joint_cloud in df_joint_clouds]

        o_gh_tree_joint_faces_segments = ghpythonlib.treehelpers.list_to_tree(o_joint_faces_segments)

        return o_gh_tree_joint_faces_segments, o_joint_segments, o_reference_point_clouds
# ---------- end dfjointsegmentator ----------
panel_8 = Panel(dfnormalsegmentator)
panel_9 = Panel(dfjointsegmentator.o_joint_segments)
move_4 = Move(Geometry=flatten(dfjointsegmentator.o_joint_face_segments), Motion=unit_z_2)  # -> Geometry, Transform
list_item_3 = ListItem(List=flatten(dfjointsegmentator.o_joint_segments), Index=Slider(1, range=0..1), Wrap=True)
beams_pcd = PointCloud(flatten(move_3.Geometry))
joints_pcd = PointCloud(flatten(move_4.Geometry))
move_5 = Move(Geometry=beams_pcd, Motion=unit_z)  # -> Geometry, Transform
dfcloudmeshdistance = DFCloudMeshDistance(i_cloud_source=move_5.Geometry, i_assembly=dfbuildassembly, i_signed_flag=Toggle(True), i_swap=Toggle(False))  # -> o_distances, o_rmse, o_max_deviation, o_min_deviation, o_std_deviation, o_result; inputs i_cloud_source: tree of PointCloud, i_signed_flag: Boolean, i_swap: Boolean, i_analysis_resolution: Double
#   port i_cloud_source: The source point cloud.
#   port i_assembly: The target DFAssembly
#   port i_signed_flag: whether to consider the sign of the distances
#   port i_swap: whether to swap source and target
#   port i_analysis_resolution: the maximum edge length of the mesh that is used for the distance calculation
#   port o_distances: list of calculated distances for each point of the source.
#   port o_rmse: average squared difference between source and target.
#   port o_max_deviation: max deviation between source and target
#   port o_min_deviation: min deviation between source and target
#   port o_std_deviation: standard deviation between source and target.
#   port o_result: The result of the distance calculation.
# ---------- dfcloudmeshdistance: Python ----------
#! python3

import Rhino
import Grasshopper
from ghpythonlib.componentbase import executingcomponent as component
from Grasshopper.Kernel import GH_RuntimeMessageLevel as RML

import diffCheck
from diffCheck import df_cvt_bindings
from diffCheck import df_error_estimation


class DFCloudMeshDistance(component):

    def RunScript(self,
            i_cloud_source: Grasshopper.DataTree[Rhino.Geometry.PointCloud],
            i_assembly,
            i_signed_flag: bool,
            i_swap: bool,
            i_analysis_resolution: float):

        if i_cloud_source is None or i_assembly is None:
            return None, None, None, None, None, None

        if i_analysis_resolution is None:
            scalef = diffCheck.df_util.get_doc_2_meters_unitf()
            i_analysis_resolution = 0.1 / scalef

        # if the input is Gh tree, flatten it
        flat_list = []
        for branch in i_cloud_source.Branches:
            flat_list.extend(list(branch))
        i_cloud_list = flat_list

        # Based on cloud source input + beam size, decide whether to calculate joints or entire assembly and output respective message
        if len(i_assembly.beams) == len(i_cloud_list):
            ghenv.Component.Message = "Per Beam"  # noqa: F821
            rh_mesh_target_list = [beam.to_mesh(i_analysis_resolution) for beam in i_assembly.beams]
        elif len(i_assembly.all_joints) == len(i_cloud_list):
            ghenv.Component.Message = "Per Joint"  # noqa: F821
            rh_mesh_target_list = [joint.to_mesh(i_analysis_resolution) for joint in i_assembly._all_joints]
        elif len(i_assembly.all_joint_faces) == len(i_cloud_list):
            ghenv.Component.Message = "Per Joint Face"  # noqa: F821
            rh_mesh_target_list = [joint_face.to_mesh() for joint_face in i_assembly.all_joint_faces]
        else:
            ghenv.Component.AddRuntimeMessage(RML.Warning, "The input number of objects to compare matches neither the number of beams nor the number of joints")  # noqa: F821
            return None, None, None, None, None, None

        # conversion
        df_cloud_source_list = [df_cvt_bindings.cvt_rhcloud_2_dfcloud(i_cl_s) for i_cl_s in i_cloud_list]

        # calculate distances
        o_result = df_error_estimation.df_cloud_2_rh_mesh_comparison(i_assembly, df_cloud_source_list, rh_mesh_target_list, i_signed_flag, i_swap)

        # distances to tree
        distances_tree = Grasshopper.DataTree[object]()
        for i, sublist in enumerate(o_result.distances):
            for j, item in enumerate(sublist):
                path = Grasshopper.Kernel.Data.GH_Path(i)
                distances_tree.Add(item, path)

        return distances_tree, o_result.distances_rmse, o_result.distances_max_deviation, o_result.distances_min_deviation, o_result.distances_sd_deviation, o_result
# ---------- end dfcloudmeshdistance ----------
script_sync_cpython = ScriptSyncCpython(
    select_file=Button(),
    i_dump=Toggle(True),
    i_export_dir=file_path,
    i_file_name="Assembly",
    i_export_seperate_files=Toggle(False),
    i_result=dfcloudmeshdistance.o_result)  # -> stdout, a; inputs select_file: Boolean, package_2_reload: String, i_dump: Double
#   port select_file: Connect a button to open a file dialog to select a cpython file to run.
#   port package_2_reload: Pass a list with the name of the custom packages you want to reload. This function is useful if you are developing a i.e. PyPI package and you want to reload the submodules after you modified something. The function will reload the package and all its submodules. If you want to reload the package and all its submodules, just pass the package name. If you want to reload only a submodule, pass the package name and the submodule name separated by a dot. If you want to reload multiple submodules, pass the package
#   port i_dump: A generic x input.
#   port stdout: The redirected standard output of the component scriptsync.
#   port a: Generic example output of the component
# ---------- script_sync_cpython: Python ----------
import System
import System.Drawing
import Rhino
import rhinoscriptsyntax as rs
import Grasshopper
import Grasshopper as gh
from Grasshopper.Kernel import GH_RuntimeMessageLevel as RML
import sys
import os
import time

import contextlib
import io

import typing

import abc
import socket
import threading
import queue
import json

import importlib
import sys

import traceback

def add_button(self,
    nickname: str,
    indx: int,
    X_param_coord: float,
    Y_param_coord: float,
    X_offset: int=100
    ) -> None:
    """
        Adds a button to the component input

        :param nickname: the nickname of the button
        :param indx: the index of the input parameter
        :param X_param_coord: the x coordinate of the input parameter
        :param Y_param_coord: the y coordinate of the input parameter
        :param X_offset: the offset of the button from the input parameter
    """
    param = ghenv.Component.Params.Input[indx]
    if param.SourceCount == 0:
        button = Grasshopper.Kernel.Special.GH_ButtonObject()
        button.NickName = ""
        button.Description = ""
        button.CreateAttributes()
        button.Attributes.Pivot = System.Drawing.PointF(
            X_param_coord - (button.Attributes.Bounds.Width) - X_offset,
            Y_param_coord - (button.Attributes.Bounds.Height / 2 - 0.1)
            )
        button.Attributes.ExpireLayout()
        Grasshopper.Instances.ActiveCanvas.Document.AddObject(button, False)
        ghenv.Component.Params.Input[indx].AddSource(button)

class GHThread(threading.Thread, metaclass=abc.ABCMeta):
    """
        A base class for Grasshopper threads.
    """
    def __init__(self, name : str):
        super().__init__(name=name, daemon=False)
        self._component_on_canvas = True
        self._component_enabled = True

    @abc.abstractmethod
    def run(self):
        """ Run the thread. """
        pass

    def _check_if_component_on_canvas(self):
        """ Check if the component is on canvas from thread. """
        def __check_if_component_on_canvas():
            if ghenv.Component.OnPingDocument() is None:
                self._component_on_canvas = False
                return False
            else:
                self._component_on_canvas = True
                return True
        action = System.Action(__check_if_component_on_canvas)
        Rhino.RhinoApp.InvokeOnUiThread(action)

    def _check_if_component_enabled(self):
        """ Check if the component is enabled from thread. """
        def __check_if_component_enabled():
            if ghenv.Component.Locked:
                self._component_enabled = False
            else:
                self._component_enabled = True
        action = System.Action(__check_if_component_enabled)
        Rhino.RhinoApp.InvokeOnUiThread(action)

    def expire_component_solution(self):
        """ Fire the recalculation of the component solution from thread. """
        def __expire_component_solution():
            ghenv.Component.Params.Output[0].ClearData()  # clear the output
            ghenv.Component.ExpireSolution(True)  # expire the component
        action = System.Action(__expire_component_solution)
        Rhino.RhinoApp.InvokeOnUiThread(action)

    def clear_component(self):
        """ Clear the component from thread. """
        def __clear_component():
            ghenv.Component.ClearData()
        action = System.Action(__clear_component)
        Rhino.RhinoApp.InvokeOnUiThread(action)

    def add_runtime_warning(self, exception : str):
        """ Add a warning tab to the component from main thread. """
        action = System.Action(
            lambda: ghenv.Component.AddRuntimeMessage(RML.Warning, exception)
        )
        Rhino.RhinoApp.InvokeOnUiThread(action)

    def add_runtime_error(self, exception : str):
        """ Add an error tab to the component from main thread. """
        action = System.Action(
            lambda: ghenv.Component.AddRuntimeMessage(RML.Error, exception)
        )
        Rhino.RhinoApp.InvokeOnUiThread(action)

    def add_runtime_remark(self, exception : str):
        """ Add a blank tab to the component from main thread. """
        action = System.Action(
            lambda: ghenv.Component.AddRuntimeMessage(RML.Remark, exception)
        )
        Rhino.RhinoApp.InvokeOnUiThread(action)

    @property
    def component_enabled(self):
        self._check_if_component_enabled()
        return self._component_enabled

    @property
    def component_on_canvas(self):
        self._check_if_component_on_canvas()
        return self._component_on_canvas

class ClientThread(GHThread):
    """
    A thread to connect to the VSCode server.
    """
    def __init__(self, vscode_server_ip: str, vscode_server_port: int, name: str,
                 queue_msg: queue.Queue = None, lock_queue_msg: threading.Lock = None,
                 event_fire_msg: threading.Event = None):
        super().__init__(name=name)
        self.vscode_server_ip = vscode_server_ip
        self.vscode_server_port = vscode_server_port
        self.is_connected = False
        self.connect_refresh_rate = 1  # seconds
        self.queue_msg = queue_msg
        self.lock_queue_msg = lock_queue_msg
        self.event_fire_msg = event_fire_msg
        self.client_socket = socket.socket(socket.AF_INET, socket.SOCK_STREAM)

    def run(self):
        """ Run the thread. Send the message to the vscode server."""
        while self.component_on_canvas and self.component_enabled:
            try:
                if not self.is_connected:
                    self.connect_to_vscode_server()
                    self.clear_component()
                    self.expire_component_solution()
                    continue

                self.event_fire_msg.wait()
                self.send_message_from_queue()

            except Exception as e:
                self.add_runtime_warning(f"script-sync::Unkown error from run: {str(e)}")
                self.is_connected = False
                self.client_socket = socket.socket(socket.AF_INET, socket.SOCK_STREAM)

        self.client_socket.close()

    def send_message_from_queue(self):
        with self.lock_queue_msg:
            if self.queue_msg and not self.queue_msg.empty():
                msg = self.queue_msg.get()
                self.queue_msg.task_done()
                self.event_fire_msg.set()
                self.event_fire_msg.clear()
                self.client_socket.send(msg)

    def connect_to_vscode_server(self):
        """ Connect to the VSCode server. """
        while self.component_on_canvas and not self.is_connected:
            try:
                self.client_socket.send(b"")
                self.is_connected = True
            except socket.error:
                try:
                    self.client_socket.connect((self.vscode_server_ip, self.vscode_server_port))
                    self.is_connected = True
                except (ConnectionRefusedError, ConnectionResetError, socket.error) as e:
                    self.handle_connection_error(e)
            finally:
                time.sleep(self.connect_refresh_rate)

    def handle_connection_error(self, e):
        error_messages = {
            ConnectionRefusedError: "script-sync::Not connected to vscode",
            ConnectionResetError: "script-sync::Connection was forcibly closed by the vscode",
            socket.error: f"script-sync::Error connecting to the vscode: {str(e)}, have you tried to press Shift+F4 on VSCode?"
        }
        self.add_runtime_warning(error_messages[type(e)])
        self.is_connected = False if type(e) != socket.error or e.winerror != 10056 else True

class FileChangedThread(GHThread):
    """
        A thread to check if the file has changed on disk.
    """
    def __init__(self,
                path : str,
                name : str
                ):
        super().__init__(name=name)
        self.path = path
        self.refresh_rate = 1000  # milliseconds
        self._on_file_changed = threading.Event()

    def run(self):
        """
            Check if the file has changed on disk.
        """
        last_modified = os.path.getmtime(self.path)
        while self.component_on_canvas and not self._on_file_changed.is_set():
            System.Threading.Thread.Sleep(self.refresh_rate)
            last_modified = self.is_file_modified(last_modified)
        self._on_file_changed.clear()
        return

    def stop(self):
        """ Stop the thread. """
        self._on_file_changed.set()

    def is_file_modified(self, last_modified):
        current_modified = os.path.getmtime(self.path)
        if current_modified != last_modified:
            self.expire_component_solution()
            return current_modified
        return last_modified

class ScriptSyncCPy(Grasshopper.Kernel.GH_ScriptInstance):
    def __init__(self):
        self._var_output = []

        self.is_success = False

        self.client_thread_name : str = f"script-sync-client-thread::{ghenv.Component.InstanceGuid}"
        self.vscode_server_ip = "127.0.0.1"
        self.vscode_server_port = 58260
        self.stdout = None
        self.queue_msg = queue.Queue()
        self.queue_msg_lock = threading.Lock()
        self.event_fire_msg = threading.Event()

        self.filechanged_thread_name : str = f"script-sync-fileChanged-thread::{ghenv.Component.InstanceGuid}"
        self.__path_name_table_value = "script-sync::" + "path::" + str(ghenv.Component.InstanceGuid)
        if self.path is None:
            ghenv.Component.Message = "select-script"
        else:
            ghenv.Component.Message = os.path.basename(self.path)

        ghenv.Component.ExpireSolution(True)
        ghenv.Component.Attributes.PerformLayout()
        params = getattr(ghenv.Component.Params, "Input")
        for j in range(len(params)):
            X_cord = params[j].Attributes.Pivot.X
            Y_cord = params[j].Attributes.InputGrip.Y
            if params[j].Name == "select_file":
                add_button(self, "Select file", j, X_cord, Y_cord)

    def RemovedFromDocument(self, doc):
        """ Remove the component from the document. """
        if self.client_thread_name in [t.name for t in threading.enumerate()]:
            client_thread = [t for t in threading.enumerate() if t.name == self.client_thread_name][0]
            client_thread.join()
        if self.filechanged_thread_name in [t.name for t in threading.enumerate()]:
            filechanged_thread = [t for t in threading.enumerate() if t.name == self.filechanged_thread_name][0]
            filechanged_thread.join()
        if self.queue_msg is not None:
            self.queue_msg.join()
        if self.queue_msg_lock is not None:
            self.queue_msg_lock.release()
        if self.event_fire_msg is not None:
            self.event_fire_msg.clear()

        # clear the path from the table view
        del self.path

    def init_script_path(self, select_file : bool = False) -> None:
        """
            Check if the button is pressed and load/change path script.
            
            :param select_file: A boolean of the button
        """
        # check if button is pressed
        if select_file is True:
            filename = rs.OpenFileName("Open", "Python Files (*.py)|*.py||")
            if filename is None:
                raise Exception("script-sync::No file selected")
            self.path = filename

        if self.path is None:
            ghenv.Component.AddRuntimeMessage(RML.Remark, "script-sync::No file selected")
            return
        else:
            # if file is in table view before
            if not os.path.exists(self.path):
                raise Exception("script-sync::File does not exist")

    def reload_all_modules(self, directory):
        for filename in os.listdir(directory):
            if filename.endswith('.py') and filename != '__init__.py':
                module_name = filename[:-3]  # remove '.py' from filename
                if module_name in sys.modules:
                    importlib.reload(sys.modules[module_name])

    def safe_exec(self, path, globals, locals, package_2_reload):
        """
            Execute Python3 code safely. It redirects the output of the code
            to a string buffer 'stdout' to output to the GH component param.
            It is send to the vscode server.
            
            :param path: The path of the file to execute.
            :param globals: The globals dictionary.
            :param locals: The locals dictionary.
            :param package_2_reload: The list of packages to reload, this is used for custom packages developement.
            installed on the system via an editable pip installation for example.
        """
        output_buffer = io.StringIO()
        try:
            sys.stdout = output_buffer
            with open(path, 'r') as f:
                # reload the specifyed packages
                if package_2_reload is not None:
                    if package_2_reload.__len__() != 0:
                        for key in list(sys.modules.keys()):
                            if package_2_reload in key:
                                # check that the package must have the attribute __file__ (to avoid reloading pyd)
                                if hasattr(sys.modules[key], '__file__'):
                                    importlib.reload(sys.modules[key])

                # add the path and sub directories to  the sys path
                path_dir = os.path.dirname(path)
                sub_dirs = []
                for root, dirs, files in os.walk(path_dir):
                    for d in dirs:
                        sub_dirs.append(os.path.join(root, d))
                sys.path.extend([path_dir] + sub_dirs)

                # reload all the modules also of the sub directories
                for root, dirs, files in os.walk(path_dir):
                    for d in dirs:
                        self.reload_all_modules(os.path.join(root, d))
                self.reload_all_modules(path_dir)

                # refresh the python interpreter
                importlib.invalidate_caches()

                # parse the code
                code = compile(f.read(), path, 'exec')
                # output = io.StringIO()

                # empty the queue and event
                with self.queue_msg_lock:
                    while not self.queue_msg.empty():
                        self.queue_msg.get()
                        self.queue_msg.task_done()
                self.event_fire_msg.clear()

                # clear all the locals dictionary to avoid that the output variables stick between the component
                # executions when it is recomputed
                outparam = ghenv.Component.Params.Output
                outparam_names = [p.NickName for p in outparam]
                for outp in outparam_names:
                    if outp in locals.keys():
                        del locals[outp]

                # execute the code
                with contextlib.redirect_stdout(output_buffer):
                    exec(code, globals, locals)
                locals["stdout"] = output_buffer.getvalue()

                # send the msg to the vscode server
                msg_json = json.dumps({"script_path": path,
                                       "guid": str(ghenv.Component.InstanceGuid),
                                       "msg": output_buffer.getvalue()})
                msg_json = msg_json.encode('utf-8')
                self.queue_msg.put(msg_json)
                self.event_fire_msg.set()

                # pass the script variables to the GH component outputs
                for outp in outparam_names:
                    if outp in locals.keys():
                        self._var_output.append(locals[outp])
                    else:
                        self._var_output.append(None)
            return locals

        except Exception as e:
            # sys.stdout = sys.__stdout__
            # Get the traceback
            tb = traceback.format_exc()

            # Send the error message to the vscode server
            err_json = json.dumps({
                "script_path": path,
                "guid": str(ghenv.Component.InstanceGuid),
                "msg": "err:" + str(e),
                "traceback": tb  # Include the traceback in the JSON
            })
            err_json = err_json.encode('utf-8')
            self.queue_msg.put(err_json)
            self.event_fire_msg.set()

            # FIXME: this is not working the retrival of the previous messages
            # for debugging purposes we include the prints before and the error message
            err_msg_header = f"script-sync::Error in the code file {path}"
            err_msg_sep = ">" * 30
            err_msg = f"script-sync::Error in the code: {str(e)}\n{tb}"
            prints_before_err_msg = output_buffer.getvalue()
            prints_before_msg = prints_before_err_msg.split("\n")

            err_msg = err_msg_header + \
                f"\n{err_msg_sep}\n" + "Error msg:" + f"\n{err_msg_sep}\n" + \
                err_msg
                # f"\n{err_msg_sep}\n" + "Preavious prints before error:" + f"\n{err_msg_sep}\n" + \
                # "\n".join(prints_before_msg[:-1])

            raise Exception(err_msg)
        
        finally:
            sys.stdout = sys.__stdout__
            output_buffer.close()

    def RunScript(self,
            select_file: bool,
            package_2_reload: str,
            i_dump: float,
            i_export_dir,
            i_file_name,
            i_export_seperate_files,
            i_result):
        """ This method is called whenever the component has to be recalculated it's the solve main instance. """
        self.is_success = False

        # set up the tcp client to connect to the vscode server
        _ = [print(t.name) for t in threading.enumerate()]
        if self.client_thread_name not in [t.name for t in threading.enumerate()]:
            ClientThread(self.vscode_server_ip,
                        self.vscode_server_port,
                        self.client_thread_name,
                        self.queue_msg,
                        self.queue_msg_lock,
                        self.event_fire_msg
                        ).start()
        
        # set the path if button is pressed
        self.init_script_path(select_file)

        # file change listener thread
        if self.filechanged_thread_name not in [t.name for t in threading.enumerate()]:
            FileChangedThread(self.path,
                            self.filechanged_thread_name
                            ).start()

    

        # add to the globals all the input parameters of the component (the locals)
        globals().update(locals())

        # execute the external script
        if self.path is not None:
            res = self.safe_exec(self.path, None, globals(), package_2_reload)
            self.is_success = True
        
        return

    def AfterRunScript(self):
        """
            This method is called as soon as the component has finished
            its calculation. It is used to load the GHComponent outputs
            with the values created in the script.
        """
        def _nesting_level(container: typing.Union[typing.List, typing.Tuple]) -> int:
            """ Get the level of nesting of a list or tuple. """
            if isinstance(container, (list, tuple)):
                return 1 + max(_nesting_level(item) for item in container)
            else:
                return 0

        def _is_nested_iterable( lst):
            """ Detect if a list is nested. """
            return any(isinstance(i, list) for i in lst)
        
        if not self.is_success:
            return

        outparam = [p for p in ghenv.Component.Params.Output]
        outparam_names = [p.NickName for p in outparam]

        for idx, outp in enumerate(outparam):
            # case: nested lists
            if type(self._var_output[idx]) == tuple or type(self._var_output[idx]) == list:
                ghenv.Component.Params.Output[idx].VolatileData.Clear()
                if _nesting_level(self._var_output[idx]) == 1:
                    ghenv.Component.Params.Output[idx].AddVolatileDataList(gh.Kernel.Data.GH_Path(0), self._var_output[idx])
                elif _nesting_level(self._var_output[idx]) == 2:
                    nbr_tuples_aka_branches = len(self._var_output[idx])
                    for i in range(nbr_tuples_aka_branches):
                        ghenv.Component.Params.Output[idx].AddVolatileDataList(gh.Kernel.Data.GH_Path(i), self._var_output[idx][i])
                elif _nesting_level(self._var_output[idx]) > 2:
                    nbr_tuples_aka_branches = len(self._var_output[idx])
                    for i in range(nbr_tuples_aka_branches):
                        for j in range(len(self._var_output[idx][i])):
                            ghenv.Component.Params.Output[idx].AddVolatileDataList(gh.Kernel.Data.GH_Path(i, j), self._var_output[idx][i][j])
            else:
                ghenv.Component.Params.Output[idx].VolatileData.Clear()
                # case: the user is returning a Grasshopper.DataTree[System.Object] via the utility ghpythonlib.treehelpers
                # e.g.: list_tree = th.list_to_tree(list_A)
                # this will be conserve the structure
                if type(self._var_output[idx]) == Grasshopper.DataTree[System.Object]:
                    self._var_output[idx].SimplifyPaths()
                    branch_count = self._var_output[idx].BranchCount
                    for i in range(branch_count):
                        path = self._var_output[idx].Paths[i]
                        print(path)
                        data = self._var_output[idx].Branch(path)
                        ghenv.Component.Params.Output[idx].AddVolatileDataList(path, data)
                # case: simple single value
                else:
                    ghenv.Component.Params.Output[idx].AddVolatileData(gh.Kernel.Data.GH_Path(0), 0, self._var_output[idx])
        self._var_output.clear()

    @property
    def path(self):
        """ Get the path of the file from the table view to be sticking between the sessions. """
        table_value = ghenv.Component.OnPingDocument().ValueTable.GetValue(
            self.__path_name_table_value, "not_found"
        )
        if table_value != "not_found":
            return table_value
        else:
            return None

    @path.setter
    def path(self, path : str):
        """ Set the path of the file to the table view to be sticking between the sessions. """
        ghenv.Component.OnPingDocument().ValueTable.SetValue(self.__path_name_table_value, path)

        script_name = os.path.basename(path)
        ghenv.Component.Message = f"{script_name}"

        if self.filechanged_thread_name in [t.name for t in threading.enumerate()]:
            _ = [t for t in threading.enumerate() if t.name == self.filechanged_thread_name][0].stop()

    @path.deleter
    def path(self):
        """ Delete the path of the file from the table view if the object is erased. """
        ghenv.Component.OnPingDocument().ValueTable.DeleteValue(self.__path_name_table_value)
# ---------- end script_sync_cpython ----------
dfvisualization_2 = DFVisualization(i_result=dfcloudmeshdistance.o_result, i_viz_settings=dfvisualizationsettings)  # -> o_colored_geo, o_legend, o_histogram; same code as dfvisualization
panel_10 = Panel(dfcloudmeshdistance.o_distances)
